# Grasshopper definition CustomType with Mesh.gh (Grasshopper 1.0.7)
# plug-ins: BH.UI.Grasshopper

# Custom Type with Mesh
panel = Panel("Material")
createcustom = CreateCustom(Type=panel, MaterialName="Clay", Component="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")
createcustom_2 = CreateCustom(Type=panel, MaterialName="Wood", Component="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")
basicgraphsettings = BasicGraphSettings(
    OntologyTitle="asd",
    OntologyDescription="asd",
    TBoxURI="http://asd.com",
    ABoxURI="http://asd.com",
    SerializeGeoToBase64=Toggle(True),
    Component="{ .BasicGraphSettings")
conmesh = ConstructMesh(Vertices=[Point(0, 0, 0), Point(10, 0, 0), Point(10, 10, 0), Point(0, 10, 0)], Faces={A=0, B=1, C=2, D=3})
createcustom_3 = CreateCustom(
    Type="Roof",
    Materials=[createcustom, createcustom_2],
    Shape=conmesh,
    TestProperty="TestPropertyValue",
    Component="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")
tottl = ToTTL(Objects=createcustom_3, GraphSettings=basicgraphsettings, Component="{ .ToTTL")
explode = Explode(Object=createcustom_3, Component="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")  # -> Type, Materials, Shape, Name, Tags, BHoM_Guid
panel_2 = Panel(explode.Materials)
explode_2 = Explode(Object=explode.Shape, Component="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")  # -> Vertices, Faces
explode_3 = Explode(Object=explode_2.Vertices, Component="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")  # -> X, Y, Z
panel_3 = Panel(explode_3.X)
panel_4 = Panel(tottl)
fromttl = FromTTL(TTLtext=panel_4, Component="{ .FromTTL")  # -> KG, OS
explode_4 = Explode(Object=fromttl.OS, Component="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")  # -> OntologyTitle, OntologyDescription, OntologyBaseAddress, TBoxSettings, ABoxSettings
explode_5 = Explode(Component="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")  # -> Vertices, Faces
explode_6 = Explode(Object=explode_5.Vertices, Component="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")  # -> X, Y, Z
panel_5 = Panel(explode_6.X)
